# Grasshopper definition robotic_drawing.ghx (Grasshopper 1.0.7)
# Copyright: © 2021 Ko Tsuruta
# plug-ins: KUKA|prc - parametric robot control

pt = ConstructPoint(XCoordinate=Slider(500, range=0..1000), YCoordinate=0, ZCoordinate=Slider(500, range=0..1000))
X = UnitX(Factor=1)
Y = UnitY(Factor=1)
python = GhPythonScript()  # -> Out, A
mesh = Mesh()
pl = ConstructPlane(Origin=pt, XAxis=expr("-x", X), YAxis=Y)
xy = XYPlane(Origin=pt)
xz = XZPlane(Origin=pt)
rotate = Rotate(Geometry=xy, Angle=3.141592654, Plane=xz)  # -> Geometry, Transform
# KRL
kuka_code = GhPythonScript()  # -> out
# ---------- kuka_code: Python ----------
"""ABOUT
    This file is an example template of a python file.
"""

# ------------------------------------------------------------------------------
# modules
# ------------------------------------------------------------------------------

from krl import KukaPython

# ------------------------------------------------------------------------------
# hard code values
# ------------------------------------------------------------------------------

_hardcode_value = 0
# tool coordinates
tx, ty, tz, ta, tb, tc = 0, 0, 0, 0, 0, 0
# base coordinates
bx, by, bz, ba, bb, bc = 0, 0, 0, 0, 0, 0

# ------------------------------------------------------------------------------
# functions
# ------------------------------------------------------------------------------

# ------------------------------------------------------------------------------
# classes
# ------------------------------------------------------------------------------

# ------------------------------------------------------------------------------
# run code
# ------------------------------------------------------------------------------

# create instance of KukaPython
k = KukaPython("my_kuka")

# set tool properties
#k.setToolNumber(0)
k.setToolCoordinates(tx, ty, tz, ta, tb, tc)

# set base properties
#k.setBaseNumber(0)
k.setBaseCoordinates(bx, by, bz, ba, bb, bc)

# run code
# ---------- end kuka_code ----------
lin_move = LINearMovementKUKAPrc(TargetAsPlane=pl, extaxenabled=False, interpolation="C_DIS")
kr6_10_r1100_2 = AgilusKR610R11002Robot(infiniterot=False)
button = Button()
kuka_prc = KUKAPrcCORE(
    SimulationSlider=Slider(0, range=0..1),
    KUKAPrcCommands=lin_move,
    Robot=kr6_10_r1100_2,
    SaveToggle=True,
    Filename="kukaprc_project",
    PRC_BaseExpose=False,
    PRC_SaveNameExpose=True,
    PRCsettings="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")  # -> RobotGeometry, AnalysisOutput
